# Dynamo graph FloorFromFloor.dyn (Dynamo 2.3.0.5885)
# packages: Hypar Dynamo 0.0.1

file_path = Filename(".\Floors-RevitToHypar.glb")
categories = Categories("OST_Floors")
all_elements_of_category = ElementsOfCategory(Category=categories)
fromRevitFloor = HyparDynamo.Hypar.Floor.FromRevitFloor(RevitFloor=all_elements_of_category)
flatten = List.Flatten(list=fromRevitFloor)
modelFromElements = HyparDynamo.Hypar.Model.ModelFromElements(elements=flatten)
writeGlb = HyparDynamo.Hypar.Model.WriteGlb(filePath=file_path, model=modelFromElements)
file_path_2 = Filename(".\Floors-RevitToHypar.json")
writeJson = HyparDynamo.Hypar.Model.WriteJson(filePath=file_path_2, model=modelFromElements)
