# Dynamo graph FloorFromFloor.dyn (Dynamo 2.3.0.5885)
# packages: Hypar Dynamo 0.0.1

categories = Categories("OST_Walls")
all_elements_of_category = ElementsOfCategory(Category=categories)
fromRevitWall = HyparDynamo.Hypar.Wall.FromRevitWall(RevitWall=all_elements_of_category)
file_path = Filename(".\RevitToDynamoToHypar.glb")
categories_2 = Categories("OST_Floors")
all_elements_of_category_2 = ElementsOfCategory(Category=categories_2)
fromRevitFloor = HyparDynamo.Hypar.Floor.FromRevitFloor(RevitFloor=all_elements_of_category_2)
flatten = List.Flatten(list=fromRevitFloor)
modelFromElements = HyparDynamo.Hypar.Model.ModelFromElements(elements=flatten)
writeGlb = HyparDynamo.Hypar.Model.WriteGlb(filePath=file_path, model=modelFromElements)
categories_3 = Categories("OST_StructuralColumns")
all_elements_of_category_3 = ElementsOfCategory(Category=categories_3)
fromRevitColumn = HyparDynamo.Hypar.Column.FromRevitColumn(column=all_elements_of_category_3)
file_path_2 = Filename(".\RevitToDynamoToHypar.json")
writeJson = HyparDynamo.Hypar.Model.WriteJson(filePath=file_path_2, model=modelFromElements)
