# Dynamo graph WallFromWall.dyn (Dynamo 2.3.0.5885)
# packages: Hypar Dynamo 0.0.1

file_path = Filename(".\Walls-RevitToHypar.glb")
select_model_element = DSModelElementSelection()  # 1 picked in the model
fromRevitWall = HyparDynamo.Hypar.Wall.FromRevitWall(RevitWall=select_model_element)
flatten = List.Flatten(list=fromRevitWall)
isNull = Object.IsNull(obj=flatten)
filterByBoolMask = List.FilterByBoolMask(list=flatten, mask=isNull)
modelFromElements = HyparDynamo.Hypar.Model.ModelFromElements(elements=filterByBoolMask.out)
writeGlb = HyparDynamo.Hypar.Model.WriteGlb(filePath=file_path, model=modelFromElements)
file_path_2 = Filename(".\Walls-RevitToHypar.json")
writeJson = HyparDynamo.Hypar.Model.WriteJson(filePath=file_path_2, model=modelFromElements)
categories = Categories("OST_Walls")
all_elements_of_category = ElementsOfCategory(Category=categories)
code_block = CodeBlock { 6; }
getItemAtIndex = List.GetItemAtIndex(list=all_elements_of_category, index=code_block)
select_model_elements = DSModelElementsSelection()  # nothing selected
code_block_2 = CodeBlock {  }
list_create = List.Create()  # unwired: item0
